# Grasshopper definition Frames.ghx (Grasshopper 0.9.76)

jamb_overhang_imperial = Slider(0.5, range=0..1)
# This assumes that you are using a 90/91 degree v-bit which is sufficiently deep to cut through the material and maintaing a 45 degree bevel throughout
bit_size_imperial = Slider(0.25, range=0..1)
frame_jamb_depth_imperial = Slider(0.5, range=0..1)
material_thickness_mm = Slider(18, range=0..24)
inner_height_imperial = Slider(11, range=0..24)
frame_total_depth_imperial = Slider(1, range=0..1)
inner_width_imperial = Slider(10, range=0..24)
xy = XYPlane(Origin=Point(0, 0, 0))

# ---- group: Material Thickness (Imperial)
multiplication = Multiplication(A=material_thickness_mm, B="0.0393701")

# ----
rectangle = Rectangle(Plane=xy, XSize=inner_width_imperial, YSize=inner_height_imperial, Radius=0)  # -> Rectangle, Length
subtraction = Subtraction(A=frame_total_depth_imperial, B=jamb_overhang_imperial)

# ---- group: Outer Width (Imperial)
addition = Addition(A=inner_width_imperial, B=subtraction)

# ---- group: Outer Height (Imperial)
addition_2 = Addition(A=inner_height_imperial, B=subtraction)

# ----
panel = Panel(addition)
panel_2 = Panel(addition_2)
addition_3 = Addition(A=frame_total_depth_imperial, B=bit_size_imperial)
vec = VectorXYZ(XComponent=addition_3, YComponent=0, ZComponent=0)  # -> Vector, Length

# ---- group: Jamb Pocket
addition_4 = Addition(A=panel, B=panel_2)
panel_3 = Panel(addition_4)
rectangle_2 = Rectangle(Plane=xy, XSize=frame_jamb_depth_imperial, YSize=panel_3, Radius=0)  # -> Rectangle, Length

# ----
pt = ConstructPoint(XCoordinate=0, YCoordinate=0, ZCoordinate=0)
pt_2 = ConstructPoint(XCoordinate=0, YCoordinate=panel_2, ZCoordinate=0)
vec2pt = Vector2Pt(PointA=pt, PointB=pt_2, Unitize=False)  # -> Vector, Length
rectangle_3 = Rectangle(Plane=xy, XSize=frame_total_depth_imperial, YSize=addition, Radius=0)  # -> Rectangle, Length
rectangle_4 = Rectangle(Plane=xy, XSize=frame_total_depth_imperial, YSize=panel_2, Radius=0)  # -> Rectangle, Length

# ---- group: height v profile
drec = DeconstuctRectangle(Rectangle=rectangle_4.Rectangle)  # -> BasePlane, XInterval, YInterval
dedomain = DeconstructDomain(Domain=drec.XInterval)  # -> Start, End
dedomain_2 = DeconstructDomain(Domain=drec.YInterval)  # -> Start, End
pt_3 = ConstructPoint(XCoordinate=dedomain.Start, YCoordinate=dedomain_2.Start, ZCoordinate=0)
pt_4 = ConstructPoint(XCoordinate=dedomain.End, YCoordinate=dedomain_2.Start, ZCoordinate=0)
pt_5 = ConstructPoint(XCoordinate=dedomain.Start, YCoordinate=dedomain_2.End, ZCoordinate=0)
pt_6 = ConstructPoint(XCoordinate=dedomain.End, YCoordinate=dedomain_2.End, ZCoordinate=0)
ln = Line(StartPoint=pt_3, EndPoint=pt_4)
ln_2 = Line(StartPoint=pt_5, EndPoint=pt_6)

# ---- group: width v profile
drec_2 = DeconstuctRectangle(Rectangle=rectangle_3.Rectangle)  # -> BasePlane, XInterval, YInterval
dedomain_3 = DeconstructDomain(Domain=drec_2.XInterval)  # -> Start, End
dedomain_4 = DeconstructDomain(Domain=drec_2.YInterval)  # -> Start, End
pt_7 = ConstructPoint(XCoordinate=dedomain_3.Start, YCoordinate=dedomain_4.Start, ZCoordinate=0)
pt_8 = ConstructPoint(XCoordinate=dedomain_3.End, YCoordinate=dedomain_4.Start, ZCoordinate=0)
pt_9 = ConstructPoint(XCoordinate=dedomain_3.Start, YCoordinate=dedomain_4.End, ZCoordinate=0)
pt_10 = ConstructPoint(XCoordinate=dedomain_3.End, YCoordinate=dedomain_4.End, ZCoordinate=0)
ln_3 = Line(StartPoint=pt_7, EndPoint=pt_8)
ln_4 = Line(StartPoint=pt_9, EndPoint=pt_10)

# ----
move = Move(Geometry=[ln_3, ln_4], Motion=vec2pt.Vector)  # -> Geometry, Transform

# ---- group: v cut lines
line = Line([move.Geometry, ln])

# ---- group: outer profile
rectangle_5 = Rectangle(Plane=xy, XSize=frame_total_depth_imperial, YSize=panel_3, Radius=0)  # -> Rectangle, Length

# ----
crv = Curve([rectangle_2.Rectangle, rectangle_5.Rectangle, line])
move_2 = Move(Geometry=crv, Motion=vec.Vector)  # -> Geometry, Transform
